# Grasshopper definition template_vias_2d_grasshopper.ghx (Grasshopper 1.0.7)

crv = Curve(<curve referenced from the Rhino model>)
crv_2 = Curve([<curve referenced from the Rhino model> x5])
offset = OffsetCurve(Curve=crv, Distance="-2", Plane=PlaneXY(0, 0, 0), Corners=1)
offset_2 = OffsetCurve(Curve=crv, Distance="2", Plane=PlaneXY(0, 0, 0), Corners=1)
boundary = BoundarySurfaces(Edges=crv_2)
offset_3 = OffsetCurve(Curve=crv, Distance="-1.6", Plane=PlaneXY(0, 0, 0), Corners=1)
offset_4 = OffsetCurve(Curve=crv, Distance="1.6", Plane=PlaneXY(0, 0, 0), Corners=1)
cir = Circle(Plane=PlaneXY(0, 0, 0), Radius=1)
srfsplit = SurfaceSplit(Surface=boundary, Curves=crv_2)
flip = FlipCurve(Curve=srfsplit, Guide=cir)  # -> Curve, Flag
neg = Negative(Value=Slider(4.99, range=0..12))
neg_2 = Negative(Value=Slider(7.5, range=0..12))
panel = Panel(srfsplit)
offset_5 = OffsetCurve(Curve=flip.Curve, Distance=neg, Plane=PlaneXY(0, 0, 0), Corners=1)
offset_6 = OffsetCurve(Curve=flip.Curve, Distance=neg_2, Plane=PlaneXY(0, 0, 0), Corners=1)
path = FilePath("C:\Users\zeca\Downloads\map (2).osm")
boundary_2 = BoundarySurfaces(Edges=offset_6)
fillet = Fillet(Curve=offset_5, Radius=Slider(2, range=0..10))
merge = Merge(Data1=fillet, Data2=offset_6)
area = Area(Geometry=fillet)  # -> Area, Centroid
pline = PolyLine(Closed=False)
division = Division(A=area.Area, B=Slider(0, range=0..1000))
format = Format(Format="{0:0.0} m²", Culture=127, Data0=area.Area)
Z = UnitZ(Factor=division)
tag = TextTag(Location=area.Centroid, Text=format)
crv_3 = Curve(pline)
extr = Extrude(Base=fillet, Direction=Z)
panel_2 = Panel(area.Area)
offset_7 = OffsetCurve(Curve=crv_3, Distance="-2", Plane=PlaneXY(0, 0, 0), Corners=1)
offset_8 = OffsetCurve(Curve=crv_3, Distance="2", Plane=PlaneXY(0, 0, 0), Corners=1)
offset_9 = OffsetCurve(Curve=crv_3, Distance="-1.6", Plane=PlaneXY(0, 0, 0), Corners=1)
offset_10 = OffsetCurve(Curve=crv_3, Distance="1.6", Plane=PlaneXY(0, 0, 0), Corners=1)
